# Grasshopper definition ISOmetricscrewthread.ghx (Grasshopper 1.0.8)

pi = Pi(Factor=1)
yz = YZPlane(Origin=Point(0, 0, 0))

# ----
# ISO metric screw thread
# Thread surfaces here
# Iso metric screw thread generation for Rhinoceros on Grasshopper
# Laurent Delrieu 9/2011
# See preferred sizes on
# http://en.wikipedia.org/wiki/ISO_metric_screw_thread
# 
# P = Pitch (mm)
# D = Diameter (mm)
# 7 points coordinates in 2D)
# 1) {0, 		D/2-3^0.5*5P/16}
# 2) {P/8, 		D/2-3^0.5*5P/16-P/(3^0.5*8)}
# 3) {P/16, 		D-3^0.5*5P/8)/2}
# 4) {9P/16, 	D}
# 5) {5P/8,	 	D+P/(3^0.5*16)}
# 6) {11P/16, 	D}
# 7) {P,		D/2-3^0.5*5P/16}
helix_points_number = Slider(36, range=10..300)
pitch_mm = Slider(1, range=0..10)
number_of_turns = Slider(10, range=0..200)
d_mm = Slider(3, range=0..64)

d_mm_2 = GetNumber(d_mm, AtLeast=1, AtMost=1, Maximum=1.797693135e+308, Minimum=-1.797693135e+308, TreeAccess=False)
pitch_mm_2 = GetNumber(pitch_mm, AtLeast=1, AtMost=1, Maximum=1.797693135e+308, Minimum=-1.797693135e+308, TreeAccess=False)
number_of_turns_2 = GetNumber(number_of_turns, AtLeast=1, AtMost=1, Maximum=1.797693135e+308, Minimum=-1.797693135e+308, TreeAccess=False)
helix_points_number_2 = GetNumber(helix_points_number, AtLeast=1, AtMost=1, Maximum=1.797693135e+308, Minimum=-1.797693135e+308, TreeAccess=False)
division = Division(A=pitch_mm_2, B=2)
division_2 = Division(A=pitch_mm_2, B=2)
X = UnitX(Factor=division_2)
neg = Negative(Value=d_mm_2)
multiplication = Multiplication(A=pitch_mm_2, B=number_of_turns_2)
dom = ConstructDomain(DomainStart=neg, DomainEnd=d_mm_2)
X_2 = UnitX(Factor=multiplication)
rectangle = Rectangle(Plane=yz, XSize=dom, YSize=dom, Radius=0)  # -> Rectangle, Length
move = Move(Geometry=rectangle.Rectangle, Motion=X_2)  # -> Geometry, Transform

# ----
# Profiles
panel = Panel("D/2-3^0.5*5*P/16")
f_x_y = F2(Function=panel, X=d_mm_2, Y=pitch_mm_2)
f_x_y_2 = F2(Function="D/2+P/(16*3^0.5)", X=d_mm_2, Y=pitch_mm_2)
f_x_y_3 = F2(Function="r-P/(8*3^0.5)", X=f_x_y, Y=pitch_mm_2)
pt_3 = ConstructPoint(XCoordinate=expr("9*x/16", pitch_mm_2), YCoordinate=0, ZCoordinate=expr("x/2", d_mm_2))
pt_2 = ConstructPoint(XCoordinate=expr("x/4", pitch_mm_2), YCoordinate=0, ZCoordinate=f_x_y)
pt_4 = ConstructPoint(XCoordinate=expr("11*x/16", pitch_mm_2), YCoordinate=0, ZCoordinate=expr("x/2", d_mm_2))
pt_1 = ConstructPoint(XCoordinate=0, YCoordinate=0, ZCoordinate=f_x_y)
pt_5 = ConstructPoint(XCoordinate=pitch_mm_2, YCoordinate=0, ZCoordinate=f_x_y)
pt_1_2 = ConstructPoint(XCoordinate=expr("x/8", pitch_mm_2), YCoordinate=0, ZCoordinate=f_x_y_3)
series = Series(Start=-2, Step=1, Count=expr("x+4", number_of_turns_2))
pt_3_4 = ConstructPoint(XCoordinate=expr("5*x/8", pitch_mm_2), YCoordinate=0, ZCoordinate=f_x_y_2)
arc = Arc3Pt(PointA=pt_3, PointB=pt_3_4, PointC=pt_4)  # -> Arc, Plane, Radius
pline = PolyLine(Vertices=[pt_4, pt_5], Closed=False)
pline_2 = PolyLine(Vertices=[pt_2, pt_3, pt_4, pt_5], Closed=False)
pline_3 = PolyLine(Vertices=[pt_1, pt_2, pt_3], Closed=False)
arc_2 = Arc3Pt(PointA=pt_1, PointB=pt_1_2, PointC=pt_2)  # -> Arc, Plane, Radius
join = JoinCurves(Curves=[arc_2.Arc, pline_2], Preserve=False)
join_2 = JoinCurves(Curves=[arc.Arc, pline_3, pline], Preserve=False)

# ----
# Helix
div = Division(FirstNumber=pi, SecondNumber=expr("x-1", helix_points_number_2))
series_2 = Series(Start=0, Step=div, Count=helix_points_number_2)
div_2 = Division(FirstNumber=division, SecondNumber=expr("x-1", helix_points_number_2))
series_3 = Series(Start=0, Step=div_2, Count=helix_points_number_2)
sin = Sine(Input=series_2)
cos = Cosine(Input=series_2)
mult = Multiplication(FirstNumber=f_x_y, SecondNumber=expr("x*-1", sin))
mult_2 = Multiplication(FirstNumber=f_x_y, SecondNumber=cos)
pt = ConstructPoint(XCoordinate=series_3, YCoordinate=mult, ZCoordinate=mult_2)
pt_6 = ConstructPoint(XCoordinate=0, YCoordinate=0, ZCoordinate=0)
pt_7 = ConstructPoint(XCoordinate=pitch_mm_2, YCoordinate=0, ZCoordinate=0)
intcrv = Interpolate(Vertices=pt, Degree=3, Periodic=False)  # -> Curve, Length, Domain
ln = Line(StartPoint=pt_6, EndPoint=pt_7)

multiplication_2 = Multiplication(A=series, B=pitch_mm_2)

X_3 = UnitX(Factor=multiplication_2)

railrev = RailRevolution(Curve=join, Rail=intcrv.Curve, Axis=ln, Scale=False)
railrev_2 = RailRevolution(Curve=join_2, Rail=intcrv.Curve, Axis=ln, Scale=False)
move_2 = Move(Geometry=railrev, Motion=X_3)  # -> Geometry, Transform
move_3 = Move(Geometry=railrev, Motion=X_3)  # -> Geometry, Transform
move_4 = Move(Geometry=railrev_2, Motion=X_3)  # -> Geometry, Transform
move_5 = Move(Geometry=railrev_2, Motion=X_3)  # -> Geometry, Transform
rotate = Rotate(Geometry=move_2.Geometry, Angle=3.141592654, Plane=PlaneYZ(0, 0, 0))  # -> Geometry, Transform
rotate_2 = Rotate(Geometry=move_4.Geometry, Angle=3.141592654, Plane=PlaneYZ(0, 0, 0))  # -> Geometry, Transform
move_6 = Move(Geometry=rotate.Geometry, Motion=X)  # -> Geometry, Transform
move_7 = Move(Geometry=rotate_2.Geometry, Motion=X)  # -> Geometry, Transform

external_male = BrepJoin(Breps=[move_3.Geometry, move_6.Geometry])  # -> Breps, Closed
internal_female = BrepJoin(Breps=[move_5.Geometry, move_7.Geometry])  # -> Breps, Closed

splitmul = SplitBrepMultiple(Brep=external_male.Breps, Cutters=[rectangle.Rectangle, move.Geometry])
panel_2 = Panel(splitmul)
splitmul_2 = SplitBrepMultiple(Brep=internal_female.Breps, Cutters=[rectangle.Rectangle, move.Geometry])
panel_3 = Panel(splitmul_2)
item = ListItem(List=splitmul, Index=0, Wrap=True)  # -> Item, Item1
item_2 = ListItem(List=splitmul_2, Index=0, Wrap=True)  # -> Item, Item1
c_bake = ContextBake(MaleExternal=item.Item1)
c_bake_2 = ContextBake(FemaleInternal=item_2.Item1)
