# Grasshopper definition PancakeExport_Stp.ghx (Grasshopper 1.0.8)
# plug-ins: Pancake

geo = GetGeometry()
string_1 = GetString()
string_2 = GetString()
save = GetBoolean()
geo_2 = GetGeometry(geo, AnnotationTypeFilter=3966, AtLeast=1, AtMost=1, DeleteInput=False, Filter=1074081855, TreeAccess=False)
string_1_2 = GetString(string_1, AtLeast=1, AtMost=1, TreeAccess=False)
string_2_2 = GetString(string_2, AtLeast=1, AtMost=1, TreeAccess=False)
save_2 = GetBoolean(save, AtLeast=1, AtMost=1, FalseValue="False", TreeAccess=False, TrueValue="True")
pcghfilepath = DefinitionPath(LastSaveLocalization="neutral,N")  # -> Directory, Name, DirectorySeparator
pcabort = Abort(Condition=invert(save_2), Passthrough=geo_2, LastSaveLocalization="neutral,N")
merge = Merge(Data1="_", Data2=string_1_2, Data3=string_2_2, Data4=".stp")
join = TextJoin(Text=[pcghfilepath.Directory, pcghfilepath.Name], Join=pcghfilepath.DirectorySeparator)
join_2 = TextJoin(Text=merge)
join_3 = TextJoin(Text=[join, join_2])
pcecstep = STEPExportOption(
    ExportParameterSpaceCurves=False,
    SplitClosedSurfaces=True,
    OmitColorsOfBlackObjects=True,
    LastSaveLocalization="neutral,N")
pcexportas = ExportAs(
    Geometry=pcabort,
    FileLocation=join_3,
    Overwrite=True,
    Options=pcecstep,
    Export=save_2,
    CompMode=False,
    LastSaveLocalization="neutral,N")  # -> OK, ExportCommand
c_bake = ContextBake(Content=pcexportas.ExportCommand)
c_bake_2 = ContextBake(Content=pcexportas.OK)
